# Grasshopper definition pix2grasshopper.gh (Grasshopper 1.0.8)
# plug-ins: RhinoCodePluginGH

# ---- group: Main pix2grasshopper Component
json_path = Panel("")
image_path = Panel("")
openai_api_key = Panel("")
generate_code = BooleanToggle(False)
data_dam = DataDam(DataA=json_path, BufferDelay=10000000, BufferMode=0)
data_dam_2 = DataDam(DataA=image_path, BufferDelay=10000000, BufferMode=0)
data_dam_3 = DataDam(DataA=openai_api_key, BufferDelay=10000000, BufferMode=0)
pix2grasshopper = Python3Script(reset=generate_code, json_path=data_dam, img_path=data_dam_2, my_key=data_dam_3)  # -> out, a, b, c; inputs json_path: String, img_path: String, my_key: String
# ---------- pix2grasshopper: Python ----------
import json
from openai import OpenAI
import os
import torch
import clip
from PIL import Image

# Initialize OpenAI client and CLIP model
client = OpenAI(api_key=my_key)
device = "cuda" if torch.cuda.is_available() else "mps"
model, preprocess = clip.load("ViT-B/32", device=device)

def load_descriptions(file_path):
    with open(file_path, 'r') as f:
        data = json.load(f)
        descriptions = []
        tokens = []
        for category, desc_list in data.items():
            descriptions.extend(desc_list)
            tokens.extend([category] * len(desc_list))
    return descriptions, tokens

def get_image_description(image_path, descriptions):
    image = preprocess(Image.open(image_path)).unsqueeze(0).to(device)
    text_inputs = clip.tokenize(descriptions).to(device)

    with torch.no_grad():
        image_features = model.encode_image(image)
        text_features = model.encode_text(text_inputs)

        similarities = (image_features @ text_features.T).softmax(dim=-1)
        best_match_idx = similarities.argmax().item()
        return descriptions[best_match_idx]

def generate_python_code_and_params(description):
    prompt = (
        f"Convert the following description into Python code using RhinoScriptSyntax "
        f"for Rhino in Grasshopper, suitable for a GHPython component: {description}. Try to make the output of the code a 3D geometric representation. "
        f"Make sure to include calls to the functions made in the script at the end of the code and output the geometry through the 'geometry' variable. "
        f"Do not include introductory or explanation text, just return the code. Remove the python formatting at the begining and end of the code block, just return the code."
        f"\n\nAdditionally, provide a dictionary where the keys are the names of the variables used in the code and the values are the suggested ranges in the form of a Python dictionary in this format 'parameter_name':[min_value, max_value]. Ignore default values or point coordinates."
        f"\n\nInclude a break comment in between the generated code and the dictionary in the form of ###BREAK###"
        f"\n\nMake sure to implement this code using the most up-to-date rhino syntax. Double check that all functions you use are valid. They must be in the Rhino API. Rhino geometry does not have a math library, just import math if it is required."

    )

    try:
        response = client.chat.completions.create(
            model="gpt-4o",
            messages=[
                {"role": "system", "content": "You are an expert in Rhino and Grasshopper scripting."},
                {"role": "user", "content": prompt}
            ],
            max_tokens=1000,
            temperature=0.2
        )
        response_text = response.choices[0].message.content.strip()

        # Assuming the response is structured as code followed by the dictionary
        split_index = response_text.rfind("###BREAK###")
        python_code = response_text[:split_index + 1].strip()
        param_dict_text = response_text[split_index+1:].strip()

        # Attempt to parse the dictionary
        try:
            param_dict = eval(param_dict_text)
        except:
            param_dict = {}

    except Exception as e:
        print(f"Error generating Python code: {e}")
        return None, None

    return python_code, param_dict

def process_image(image_path):
    descriptions, tokens = load_descriptions(json_path)

    description = get_image_description(image_path, descriptions)
    print(f"Description generated by CLIP: {description}")

    # Output the description to the variable 'c'
    c = description

    python_code, param_dict = generate_python_code_and_params(description)
    print(f"Generated Python Code:\n{python_code}")

    return python_code, param_dict, c

# Main function for GHPython
if reset:  # 'reset' is the boolean input from the Button
    image_path = img_path
    generated_code, parameters, c = process_image(image_path)
    a = generated_code
    b = json.dumps(parameters)
# ---------- end pix2grasshopper ----------

# ----
python_3_script = Python3Script(slider_string=pix2grasshopper.b)  # -> out, a
# ---------- python_3_script: Python ----------
import random
import Grasshopper.Kernel as gh
import Grasshopper.Kernel.Special as gh_special
import System.Drawing as drawing
import System
import ast

def parse_slider_string(slider_string):
    # Convert the string to a dictionary
    slider_dict = ast.literal_eval(slider_string)
    return slider_dict

def create_sliders_from_dict(slider_dict):
    # Get the active Grasshopper document
    doc = ghenv.Component.OnPingDocument()
    
    # Get the position of the current component
    component_pivot = ghenv.Component.Attributes.Pivot
    x_offset = component_pivot.X
    y_offset = component_pivot.Y + 100  # Adjust the vertical offset as needed

    for i, (name, (min_range, max_range)) in enumerate(slider_dict.items()):
        slider = gh_special.GH_NumberSlider()
        slider.CreateAttributes()

        slider.Slider.Minimum = System.Decimal(min_range)
        slider.Slider.Maximum = System.Decimal(max_range)
        slider.Slider.Value = System.Decimal(random.uniform(min_range, max_range))
        slider.NickName = name

        slider.Attributes.Pivot = drawing.PointF(
            x_offset,
            y_offset + i * 50  # Adjust the spacing between sliders as needed
        )

        doc.AddObject(slider, False)

# Example usage: parse the string and create sliders
slider_dict = parse_slider_string(slider_string)
create_sliders_from_dict(slider_dict)
# ---------- end python_3_script ----------
generated_code = Panel(pix2grasshopper.a)
panel = Panel(pix2grasshopper.c)
script_editor = Python3Script()  # -> out, geometry
code_executable = Python3Script(script=pix2grasshopper.a)  # -> out, geometry
