# Grasshopper definition pix2grasshopper_main_demo_example.gh (Grasshopper 1.0.8)
# plug-ins: RhinoCodePluginGH

# ---- group: File Paths & Keys
json_path = Panel("")
# Instructions: Welcome to pix2grasshopper. To begin using this workflow, start by entering the full path to the JSON file called "descriptions.json" included in the pix2grasshopper file repository. The full path should begin at the top of your users directory (i.e. /Users) Then, enter the path of the image you would like to convert into Python code, again starting from the users directory. Finally, enter your OpenAI API key. Once you are done, you may now set the "Generate Code" toggle switch to True. You may have to wait a moment for the code to run and the geometry to appear. Longer wait times usually mean that the "Code Checker" component is making API requests to fix faulty code. However you should not have to wait longer than a minute. Otherwise restart Rhino and try again.
# 
# Once loaded, the geometry should appear in the Rhino viewport and the "Code Executable" component should generate sliders that correspond to parameters. Currently, these sliders cannot manipulate the geometry on generation. In order to do this, you can do two things. Either enter into the "Code Executable" component and manually run it, which will update the component to now be able to read the sliders. Or, you can delete one of the sliders, that same slider will be regenerated. You can now manipulate the sliders and the geometry will update.
# 
# This system is a work in progress and will often not generate geometry or not return code or parameters when needed. If you attempt to run the workflow and the "Code Executable" component generates sliders, but you do not see a geometry in the Rhino viewport, you may need to run it a few times until you receive a valid geometry or try a different picture. To run the workflow again after an unsuccessful attempt you need to start by setting the "Generate Code" toggle back to False, this is necessary to pause the code transfer process. Then, click the "Clear Input" button to clear out the existing inputs on the "Code Executable" component, you might see an empty error popup, ignore it and set it to not show all future popups. If Grasshopper becomes  unresponsive after the first reset, click the reset button again and it will become responsive.
# 
# WARNING: ONLY PRESS THE CLEAR INPUTS BUTTON WHEN THE "CODE EXECUTABLE" COMPONENT HAS AN EQUAL NUMBER OF INPUTS AND SLIDERS CONNECTED TO THEM, NO MORE NO LESS. OTHERWISE, THE COMPONENT WILL TIME OUT IN A PROCESS ERROR. IF THIS HAPPENS YOU NEED TO CREATE A NEW "CODE EXECUTABLE" COMPONENT BY COPYING AND PASTING A NEW ONE AND DELETING THE OLD ONE. YOU WILL NEED TO REWIRE THE GEOMETRY OUTPUT TO THE PANEL.
# 
# Once you have no inputs in the "Code Executable" component, you can now set the "Generate Code" toggle to True once again, and repeat until you receive a valid geometry in the viewport. Continue to find different images that correspond to tokenized descriptions in the JSON file to find out what other geometries can be made.
openai_api_key = Panel("")
image_path = Panel("")
data_dam = DataDam(DataA=json_path, BufferDelay=10000000, BufferMode=0)
data_dam_2 = DataDam(DataA=image_path, BufferDelay=10000000, BufferMode=0)
data_dam_3 = DataDam(DataA=openai_api_key, BufferDelay=10000000, BufferMode=0)

# ---- group: Python Components
generate_code = BooleanToggle(False)
clear_inputs = Button()
pix2grasshopper = Python3Script(on_off=generate_code, json_path=data_dam, img_path=data_dam_2, my_key=data_dam_3)  # -> code, params, desc; inputs json_path: String, img_path: String
# ---------- pix2grasshopper: Python ----------
### Utilized assistance from OpenAIs ChatGPT to write and implement this code

"""
Processes an input image to generate a caption using the CLIP model and creates Python code for nature-inspired geometry 
in Grasshopper using OpenAI's GPT API. Outputs include the generated code, parameter ranges, and image description.

Inputs:
- my_key (str): OpenAI API key.
- img_path (str): Path to the input image.
- json_path (str): Path to the token JSON.
- on_off (bool): Trigger to run the script.

Outputs:
- code (str): Generated Python code for Grasshopper.
- params (str): JSON string of parameter names and ranges.
- desc (str): Image description from CLIP.
"""

# requirements: openai
# requirements: torch
# requirements: pillow
# requirements: git+https://github.com/openai/CLIP.git
import json
from openai import OpenAI
import os
import torch
import clip
from PIL import Image

client = OpenAI(api_key=my_key)
device = "cuda" if torch.cuda.is_available() else "mps"
model, preprocess = clip.load("ViT-B/32", device=device)

def load_descriptions(file_path):
    with open(file_path, 'r') as f:
        data = json.load(f)
        descriptions = []
        tokens = []
        for category, desc_list in data.items():
            descriptions.extend(desc_list)
            tokens.extend([category] * len(desc_list))
    return descriptions, tokens

def get_image_description(image_path, descriptions):
    image = preprocess(Image.open(image_path)).unsqueeze(0).to(device)
    text_inputs = clip.tokenize(descriptions).to(device)

    with torch.no_grad():
        image_features = model.encode_image(image)
        text_features = model.encode_text(text_inputs)

        similarities = (image_features @ text_features.T).softmax(dim=-1)
        best_match_idx = similarities.argmax().item()
        return descriptions[best_match_idx]

def generate_python_code_and_params(description):
    prompt = (
        f"Create python code using RhinoScriptSyntax for Rhino in Grasshopper, suitable for a GHPython component that will create 3D geometry based on the following description: {description}. Make sure to output that geometry through a 'geometry' output variable."
        f"Also, don't define your parameter variables that are numbers, but still use them in function calls, assume they will be fed in as inputs of the same variable name. Assume all inputs are in the form of a float value so cast all integer parameters within the code as int(). Ensure all other types of parameters like points or curves are pre-defined in the code before they are used in a function."
        f"Do not include introductory or explanation text. Remove all code block formatting (i.e. ```python)."
        f"Additionally, provide a dictionary where the keys are the names of the variables used in the code and the values are the suggested ranges in the form of a Python dictionary in this format 'parameter_name':[min_value, max_value]. Ignore point coordinates."
        f"Include a break comment in between the generated code and the dictionary in the form of ###BREAK###"
        f"\n\nMake sure to implement this code using the most up-to-date Rhino syntax. Check to see that all attributes and functions are valid and within their appropriate modules. Be mindful of conversions between types. Rhino geometry does not have a math library, just import math."
    )

    try:
        response = client.chat.completions.create(
            model="gpt-4o",
            messages=[
                {"role": "system", "content": "You are an expert in Rhino and Grasshopper scripting."},
                {"role": "user", "content": prompt}
            ],
            max_tokens=1500,
            temperature=0.2
        )
        response_text = response.choices[0].message.content.strip()

        split_index = response_text.rfind("###BREAK###")
        python_code = response_text[:split_index].strip()
        param_dict_text = response_text[split_index+1:].strip()

        try:
            param_dict = eval(param_dict_text)
        except:
            param_dict = {}

    except Exception as e:
        print(f"Error generating Python code: {e}")
        return None, None

    return python_code, param_dict

def process_image(image_path, json_path, my_key):
    descriptions, tokens = load_descriptions(json_path)

    description = get_image_description(image_path, descriptions)
    print(f"Description generated by CLIP: {description}")

    python_code, param_dict = generate_python_code_and_params(description)
    print(f"Generated Python Code:\n{python_code}")

    return python_code, param_dict, description

if on_off:
    image_path = img_path
    generated_code, parameters, description = process_image(image_path, json_path, my_key)
    code = generated_code
    params = json.dumps(parameters)
    desc = description
# ---------- end pix2grasshopper ----------
code_checker = Python3Script(code=pix2grasshopper.code, params=pix2grasshopper.params, my_key=openai_api_key)  # -> errors, feedback
# ---------- code_checker: Python ----------
### Utilized assistance from OpenAIs ChatGPT to write and implement this code

"""
Processes an input Python code string, parses dynamic inputs from a dictionary, executes
the code, and handles errors by fetching code suggestions from OpenAI to fix the issues. 

Inputs:
- my_key (str): OpenAI API key.
- params (str): Dictionary string representing dynamic slider inputs, parsed into a Python dictionary.
- code (str): Python code string to be executed with dynamic inputs.

Outputs:
- feedback (str): The original or corrected Python code after execution, including suggestions for errors.
- exec_results (dict): The results from executing the Python code.
"""

import ast
import openai

client = openai.OpenAI(api_key=my_key)

error_cache = {}
call_count = 0

def parse_slider_string(slider_string):
    try:
        slider_dict = ast.literal_eval(slider_string)
        if not isinstance(slider_dict, dict):
            raise ValueError("Input must be a dictionary.")
        for key, value in slider_dict.items():
            if not isinstance(value, list) or len(value) != 2:
                raise ValueError(f"Key '{key}' must map to a list of two float numbers.")
            if not all(isinstance(num, (float, int)) for num in value):
                raise ValueError(f"Key '{key}' range must contain only float or integer values.")
        return slider_dict
    except Exception as e:
        print(f"Error parsing slider string: {e}")
        return {}

def execute_code(code_string, inputs):
    try:
        exec_context = {"__builtins__": __builtins__}
        exec_context.update(inputs)
        exec(code_string, exec_context)
        return None, {k: v for k, v in exec_context.items() if k not in inputs}
    except Exception as e:
        return str(e), {}

def fetch_code_suggestions(error_message, code_string):
    prompt = (
        f"Provide a new Grasshopper Python script that is fixing this code: {code_string} that has this error message {error_message}."
        f"Do not include introductory or explanation text. Remove all code block formatting (i.e. ```python)."
        f"Also, don't define your parameter variables that are numbers, but still use them in function calls, assume they will be fed in as inputs of the same variable name. Assume all inputs are in the form of a float value so cast all integer parameters within the code as int(). Ensure all other types of parameters like points or curves are pre-defined in the code before they are used in a function."
    )

    try:
        if error_message in error_cache:
            return error_cache[error_message]
        
        response = client.chat.completions.create(
            model="gpt-4o",
            messages=[
                {"role": "system", "content": "You are an expert in Rhino and Grasshopper scripting."},
                {"role": "user", "content": prompt}
            ],
            max_tokens=1000,
            temperature=0.2
        )

        suggestion = response.choices[0].message.content.strip()
        error_cache[error_message] = suggestion
        return suggestion
    except Exception as e:
        print(f"Failed to fetch suggestions: {e}")
        return None

try:
    if params:
        parsed_dict = parse_slider_string(params)

        if not isinstance(parsed_dict, dict):
            raise ValueError("Input must be a dictionary.")

        input_values = {key: value[0] for key, value in parsed_dict.items()}

    if code:
        error, exec_results = execute_code(code, input_values)
        errors = []
        if error:
            corrected_code = code
            while error and call_count < 5:
                errors.append(error)
                corrected_code = fetch_code_suggestions(error, corrected_code)
                error, exec_results = execute_code(corrected_code, input_values)
                call_count = call_count + 1
            feedback = corrected_code
        else:
            feedback = code


except Exception as e:
    print(f"Error in component execution: {e}")
# ---------- end code_checker ----------
code_executable = Python3Script(reset=clear_inputs, code=code_checker.feedback, params=pix2grasshopper.params)  # -> geometry
# ---------- code_executable: Python ----------
### Utilized assistance from OpenAIs ChatGPT to write and implement this code

"""
Manages input sliders in Grasshopper, parses dictionary strings into Python dictionaries, executes
provided code with dynamically generated inputs, and manages sliders based on parsed input values. 
It can also clear dynamic inputs and associated sliders, and it handles errors during execution.

Inputs:
- params (str): A string representing a dictionary of dynamic input ranges.
- code (str): The Python code string to be executed with dynamic inputs.
- reset (bool): Flag to clear dynamic inputs and sliders.

Outputs:
- geometry: The processed results (geometry) after code execution.
"""

import Rhino
import scriptcontext as sc
import rhinoscriptsyntax as rs
import Grasshopper as gh
import Grasshopper.Kernel.Special as gh_special
import System.Drawing as drawing
import System
import ast
from openai import OpenAI

cached_values = {}
sliders_created = False  

def parse_slider_string(slider_string):
    try:
        slider_dict = ast.literal_eval(slider_string)
        if not isinstance(slider_dict, dict):
            raise ValueError("Input must be a dictionary.")
        for key, value in slider_dict.items():
            if not isinstance(value, list) or len(value) != 2:
                raise ValueError(f"Key '{key}' must map to a list of two float numbers.")
            if not all(isinstance(num, (float, int)) for num in value):
                raise ValueError(f"Key '{key}' range must contain only float or integer values.")
        return slider_dict
    except Exception as e:
        print(f"Error parsing slider string: {e}")
        return {}

def create_sliders_once(slider_dict):
    doc = ghenv.Component.OnPingDocument()
    component_pivot = ghenv.Component.Attributes.Pivot
    x_offset = component_pivot.X - 320
    y_offset = component_pivot.Y - 70
    sliders_created = False  

    existing_sliders = {}
    for param in ghenv.Component.Params.Input:
        if param.Sources:
            source = param.Sources[0]
            if isinstance(source, gh_special.GH_NumberSlider):
                existing_sliders[source.NickName] = source

    for i, (name, (min_range, max_range)) in enumerate(slider_dict.items()):
        if name in existing_sliders:
            slider = existing_sliders[name]

            if slider.Slider.Minimum != System.Decimal(min_range) or slider.Slider.Maximum != System.Decimal(max_range):
                slider.Slider.Minimum = System.Decimal(min_range)
                slider.Slider.Maximum = System.Decimal(max_range)
            continue 

        slider = gh_special.GH_NumberSlider()
        slider.CreateAttributes()

        slider.Slider.Minimum = System.Decimal(min_range)
        slider.Slider.Maximum = System.Decimal(max_range)
        slider.Slider.Value = System.Decimal((min_range + max_range) / 2)
        slider.NickName = name
        slider.Slider.DecimalPlaces = 2

        slider.Attributes.Pivot = drawing.PointF(x_offset, y_offset + i * 25)

        doc.AddObject(slider, False)

        if i + 3 < len(ghenv.Component.Params.Input):
            input_param = ghenv.Component.Params.Input[i + 3]
            input_param.AddSource(slider)

            input_param.ExpireSolution(False)

        
        sliders_created = True 

    if sliders_created:
        def expire_solution():
            ghenv.Component.ExpireSolution(True)

        doc.ScheduleSolution(1, gh.Kernel.GH_Document.GH_ScheduleDelegate(expire_solution))

def get_slider_values():
    output_values = {}

    for i in range(3, len(ghenv.Component.Params.Input)):  
        input_param = ghenv.Component.Params.Input[i]
        if input_param.Sources:
            slider = input_param.Sources[0]
            slider_value = System.Decimal.ToDouble(slider.Slider.Value)
            output_values[input_param.NickName] = slider_value

    return output_values

def execute_code(code_string, inputs):
    try:
        exec_context = {"__builtins__": __builtins__}
        exec_context.update(inputs)
        exec(code_string, exec_context)
        return None, {k: v for k, v in exec_context.items() if k not in inputs}
    except Exception as e:
        return str(e), {}

def clear_dynamic_inputs():
    doc = ghenv.Component.OnPingDocument()

    inputs_to_remove = []
    for i, param in enumerate(ghenv.Component.Params.Input):
        if i >= 3: 
            inputs_to_remove.append(param)

    for param in inputs_to_remove:
        for source in list(param.Sources): 
            if isinstance(source, gh_special.GH_NumberSlider):
                doc.RemoveObject(source, False)
        ghenv.Component.Params.UnregisterInputParameter(param)

try:
    if reset:
        clear_dynamic_inputs()

    else:
        if params:
                parsed_dict = parse_slider_string(params)

                if not isinstance(parsed_dict, dict):
                    raise ValueError("Input must be a dictionary.")
                
                existing_params = [p.NickName for p in ghenv.Component.Params.Input]

                for key, value in parsed_dict.items():
                    if key not in existing_params:
                        param = gh.Kernel.Parameters.Param_Number()
                        param.Name = str(key)
                        param.NickName = str(key)
                        param.Description = f"Range for {key}: {value[0]} to {value[1]}"
                        param.Access = gh.Kernel.GH_ParamAccess.item
                        param.Optional = True
                        ghenv.Component.Params.RegisterInputParam(param)

                create_sliders_once(parsed_dict)

                output_values = get_slider_values()
                
                error, exec_results = execute_code(code, output_values)

                results = exec_results.get("geometry", None)
                
                output_roots = []
                if isinstance(results, list):
                    for obj in results:
                        if isinstance(obj, list):
                            output_roots.extend(obj)
                        else:
                            output_roots.append(obj)

                    geometry = output_roots
                else:
                    geometry = results;
                
                

except Exception as e:
    print(f"Unexpected error: {e}")
# ---------- end code_executable ----------

# ---- group: Outputs
parameters = Panel(pix2grasshopper.params)
errors_fixed = Panel(code_checker.errors)
generated_code = Panel(pix2grasshopper.code)
description = Panel(pix2grasshopper.desc)
geometry = Panel(code_executable)

# ----
my_dynamic_slider = Slider(5, range=0..10)
my_dynamic_slider_2 = Slider(5, range=0..10)
my_dynamic_slider_3 = Slider(5, range=0..10)
my_dynamic_slider_4 = Slider(5, range=0..10)
